% Simulink data dictionary week2_2.sldd

Fn = Simulink.Parameter([0 0
 1 0.8
 2 1.6
 3 1.6
 4 1.6
 5 1.6
 6 0.8
 7 0
 8 0
 9 0
 10 0])

R = Simulink.Parameter(1)

Tin = Simulink.Parameter([1 2
 2 2
 3 2
 4 2
 5 2
 6 0
 7 0
 8 0
 9 0
 10 0])

be = Simulink.Parameter(2)
bv = Simulink.Parameter(1)
f1 = Simulink.Parameter([1; 6; 11; 16; 21; 26; 31; 36; 41; 46; 51])
le = Simulink.Parameter(1)
lv = Simulink.Parameter(5)
muk = Simulink.Parameter(1)
mus = Simulink.Parameter(1.5)
Sig = Simulink.Signal()